# Grasshopper definition sum.gh (Grasshopper 1.0.7)

A = GetNumber("1", AtLeast=1, AtMost=1, Maximum=1.797693135e+308, Minimum=-1.797693135e+308)
B = GetNumber("1", AtLeast=1, AtMost=1, Maximum=1.797693135e+308, Minimum=-1.797693135e+308)
addition = Addition(A=A, B=B)

# ---- group: RH_OUT:result
num = Number(addition)
